# Grasshopper definition parametricVase1.gh (Grasshopper 0.9.76)

number_slider = Slider(10, range=0..10)
dom = ConstructDomain(DomainStart=Slider(0.1, range=0..0.1), DomainEnd=Slider(1, range=0..1))
dom_2 = ConstructDomain(DomainStart=0, DomainEnd=Slider(200, range=0..1000))
range = Range(Domain=dom, Steps=number_slider)
range_2 = Range(Domain=dom_2, Steps=number_slider)
graph = GraphMapper(
    range,
    x0=0,
    x1=1,
    y0=0,
    y1=1,
    container_name="Bezier",
    cpx=[0, 0.2164850682, 0.4159421921, 1],
    cpy=[0, 0.9007813931, 0.7345666885, 1])
pt = ConstructPoint(XCoordinate=0, YCoordinate=0, ZCoordinate=range_2)
multiplication = Multiplication(A=graph, B=Slider(200, range=0..1000))
multiplication_2 = Multiplication(A=graph, B=Slider(190, range=0..1000))
cir = Circle(Plane=pt, Radius=multiplication)
lng = ListLength(List=cir)
item = ListItem(List=cir, Index=expr("x-1", lng), Wrap=True)
cir_2 = Circle(Plane=pt, Radius=multiplication_2)
lng_2 = ListLength(List=cir_2)
item_2 = ListItem(List=cir_2, Index=expr("x-1", lng_2), Wrap=True)
item_3 = ListItem(List=cir_2, Index=0, Wrap=True)
item_4 = ListItem(List=cir, Index=0, Wrap=True)
Z = UnitZ(Factor=expr("-x", Slider(10, range=0..100)))
extr = Extrude(Base=item_4, Direction=Z)
boundary = BoundarySurfaces(Edges=[item_4, item_3])
boundary_2 = BoundarySurfaces(Edges=[item_2, item])
loft = Loft(Curves=cir, Options={Adjust=False, Closed=False, LoftEnds=0, LoftSimp=0, LoftType=0, Rebuild=10, Refit=0.01})
loft_2 = Loft(Curves=cir_2, Options={Adjust=False, Closed=False, LoftEnds=0, LoftSimp=0, LoftType=0, Rebuild=10, Refit=0.01})
flip = Flip(Surface=loft)  # -> Surface, Result
flip_2 = Flip(Surface=loft_2)  # -> Surface, Result
join = BrepJoin(Breps=flatten([boundary, boundary_2, flip.Surface, flip_2.Surface]))  # -> Breps, Closed
cap = CapHoles(Brep=extr)
polygon = Polygon(Plane=PlaneXY(0, 0, 0), Radius=Slider(20, range=0..100), Segments=Slider(4, range=0..10), FilletRadius=0)  # -> Polygon, Length
sunion = SolidUnion(Breps=flatten([join.Breps, cap]))
pt_2 = ConstructPoint(XCoordinate=0, YCoordinate=0, ZCoordinate=Slider(22, range=0..100))
mesh_uv = MeshSurface(Surface=flip.Surface, UCount=Slider(10, range=0..100), VCount=Slider(19, range=0..100), Overhang=True, Equalize=False)
extr_2 = ExtrudePoint(Base=polygon.Polygon, Point=pt_2)
Z_2 = UnitZ(Factor=Slider(10, range=0..100))
cap_2 = CapHoles(Brep=extr_2)
faceb = FaceBoundaries(Mesh=mesh_uv)
dom²num = ConstructDomain²(UMin=0, UMax=1, VMin=0, VMax=1)
move = Move(Geometry=cap_2, Motion=Z_2)  # -> Geometry, Transform
boundary_3 = BoundarySurfaces(Edges=faceb)
bbox = BoundingBox(Content=move.Geometry, Plane=PlaneXY(0, 0, 0), UnionBox=True)  # -> Box, Box_2
sbox = SurfaceBox(Surface=reparameterize(boundary_3), Domain=dom²num, Height=Slider(10, range=0..10))
area = Area(Geometry=boundary_3)  # -> Area, Centroid
morph = BoxMorph(Geometry=cap_2, Reference=bbox.Box, Target=sbox)
scale = Scale(Geometry=morph, Center=area.Centroid, Factor=Slider(0.76, range=0..1))  # -> Geometry, Transform
sdiff = SolidDifference(BrepsA=sunion, BrepsB=scale.Geometry)
