# Grasshopper definition gHowl_OSC_Mouse2D.ghx (Grasshopper 0.8.1)

# ---- group: Receive
send_pattern_osc = Panel("999")
port = Panel("12001")
udp = UDPReceiver(Port=port, Pattern=send_pattern_osc)  # -> Info, Data
# Local OSC Send And Receive Test
# 
# This definition tests the sending of an OSC message to an associated Processing sketch called gHowl_OSC_Mouse2D.pde
# 
# REQUIREMENTS:
# Processing: http://ww.processing.org
# The Processing oscP5 library by Andreas Schlegel which can be found here: http://www.sojamo.de/libraries/oscP5/
# 
# ==================================================
# gHowl is a set of components which extend Grasshopper's ability to communicate and exchange information with other applications and physical devices.
# 
# Keep up with the latest developments of gHowl on the
# gHowl group on grasshopper3d.com:
# http://www.grasshopper3d.com/group/ghowl
# 
# gHowl is developed by:
# Damien Alomar: http://www.liquidtectonics.com
# Luis E. Fraguada: http://www.livearchitecture.net
# Giulio Piacentino: http://www.giuliopiacentino.com
message = Panel([udp.Info, udp.Data])
item = ListItem(List=udp.Data, Index=1, Wrap=False)
item_2 = ListItem(List=udp.Data, Index=2, Wrap=False)
pt = PointXYZ(XComponent=item, YComponent=item_2, ZComponent=0)
sph = Sphere(Base=pt, Radius=item)

# ---- group: Send
md_slider = MDSlider(slider_value=Point(0.4879239114, 0.40234375, 0.5), x_domain=Domain(0, 1), y_domain=Domain(0, 1), z_domain=Domain(0, 1))
address_pattern = Panel("/gHowlTest")
pcomp = Decompose(Point=md_slider)  # -> XComponent, YComponent, ZComponent
remap = RemapNumbers(Values=pcomp.XComponent, Source=Domain(0, 1), Target=Domain(0, 200))
remap_2 = RemapNumbers(Values=pcomp.YComponent, Source=Domain(0, 1), Target=Domain(0, 200))
osc_message = Panel([address_pattern, remap, remap_2])
send_pattern_osc_2 = Panel("999")
port_2 = Panel("12000")
udp_2 = UDPSender(Port=port_2, Pattern=send_pattern_osc_2, Data=osc_message)
