# Grasshopper definition circlePacking2.gh (Grasshopper 0.9.76)
# plug-ins: gHowl

# ---- group: ReceiveOSC
send_pattern_osc = Panel("999")
port = Panel("12001")
udp = UDPReceiver(Port=port, Pattern=send_pattern_osc)  # -> Info, Data
message = Panel([udp.Info, udp.Data])

# ----
lng = ListLength(List=udp.Data)
dom = ConstructDomain(DomainStart=1, DomainEnd=expr("x-1", lng))
subset = SubList(List=udp.Data, Domain=dom, Wrap=True)  # -> List, Index
partition = PartitionList(List=subset.List, Size=3)  # -> simplify(Chunks)
item = ListItem(List=partition, Index=1, Wrap=True)  # -> flatten(Item)
item_2 = ListItem(List=partition, Index=2, Wrap=True)  # -> flatten(Item)
item_3 = ListItem(List=partition, Index=2, Wrap=True)  # -> flatten(Item)
item_4 = ListItem(List=partition, Index=0, Wrap=True)  # -> flatten(Item)
pt = ConstructPoint(XCoordinate=item, YCoordinate=item_4, ZCoordinate=item_3)
multiplication = Multiplication(A=item_2, B=Slider(1, range=0..1))
cir = Circle(Plane=pt, Radius=multiplication)
