# Grasshopper definition flocking1.gh (Grasshopper 0.9.76)
# plug-ins: gHowl

# ---- group: ReceiveOSC
send_pattern_osc = Panel("999")
port = Panel("12001")
udp = UDPReceiver(Port=port, Pattern=send_pattern_osc)  # -> Info, Data
message = Panel([udp.Info, udp.Data])

# ----
lng = ListLength(List=udp.Data)
dom = ConstructDomain(DomainStart=1, DomainEnd=expr("x-1", lng))
subset = SubList(List=udp.Data, Domain=dom, Wrap=True)  # -> List, Index
partition = PartitionList(List=subset.List, Size=2)  # -> simplify(Chunks)
item = ListItem(List=partition, Index=1, Wrap=True)  # -> flatten(Item)
item_2 = ListItem(List=partition, Index=0, Wrap=True)  # -> flatten(Item)
pt = ConstructPoint(XCoordinate=item, YCoordinate=item_2, ZCoordinate=0)
con = DelaunayEdges(Points=pt, Plane=PlaneXY(0, 0, 0))  # -> Connectivity, Edges
